# Grasshopper definition GHCitySim.ghx (Grasshopper 0.9.76)
# plug-ins: Python Interpreter

# ----
# 0. Set initial parameters...
# You can download CitySim solver from
# http://citysim.epfl.ch
# ... and let the bees and bugs fly
name_of_the_simulation = Panel("test")
# GH-CitySim: an interface to CitySim started by Giuseppe Peronato
# 
# © All rights reserved. Ecole polytechnique fédérale de Lausanne (EPFL), Switzerland,
# Interdisciplinary Laboratory of Performance-Integrated Design (LIPID), 2016-2017
# Developer: Giuseppe Peronato <giuseppe.peronato@epfl.ch>
# 
# CitySim is a software developed and distributed by the
# Laboratory of Solar Energy and Building Physics (LESO-PB)
# http://citysim.epfl.ch/
# 
# Contributors:
# Aymeric Delmas <aymeric.delmas@imageen.re>
# 
# This tool relies on and will hopefully be part of
# Ladybug and Honeybee: two plugins for Environmental Analysis (GPL)
# started by Mostapha Sadeghipour Roudsari
select_your_path = Panel("C:\Users\peronato\Desktop\CitySimGH")
path_to_citysim_solver = Panel("C:\CitySim.exe")
path_to_weather_file_epw = Panel("C:\Users\peronato\Documents\WeatherFiles\Neuchatel-hour.epw")
honeybee = Honeybee_Honeybee()  # -> Vviiiiiiiiiizzz; plug-in component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
ladybug = Ladybug_Ladybug()  # -> Vviiiiiiiiiizzz; plug-in component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
directory = FilePath(select_your_path)
solver_path = Text(path_to_citysim_solver)
name = Text(name_of_the_simulation)
epw_path = FilePath(path_to_weather_file_epw)

# ----
# 1. Import Geometry
# In order to ceate HoneyBee zones, make sure you use closed breps only.
# Warning: Brep 2 is not closed because of the overhangs.
# You can simulate it only using the alternative workflow for solar radiation wiithout HoneyBee.
select_breps_to_simulate = Panel("""0
1
2""")
brep = Brep([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])
item = ListItem(List=brep, Index=select_breps_to_simulate, Wrap=True)
intersectmass = Honeybee_IntersectMasses(bldgMassesBefore=flatten(item))  # -> bldgMassesAfter; plug-in component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
panel = Panel(brep)
brep_2 = Brep(intersectmass)
panel_2 = Panel(brep_2)

# ----
# Developer only
toggle = BooleanToggle(False)
exportladybug = Ladybug_ExportLadybug(components="*", targetFolder="C:\Users\peronato\Documents\GitHub\GHCitySim", export=toggle)  # -> readMe; plug-in component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

# ----
# HoneyBee zones:
# Activate components before running the simulation
# NO MASS MATERIALS ARE NOT SUPPORTED FOR NOW
reflectivity = Slider(0.2, range=0..1)
u_value = Slider(0.17, range=0..1)
u_value_2 = Slider(0.25, range=0..1)
number_slider = Slider(80, range=0..100)
brep_3 = Brep(brep_2)
number_slider_2 = Slider(0.036, range=0..0.1)
number_slider_3 = Slider(0.14, range=0..1)
number_slider_4 = Slider(0.036, range=0..0.1)
number_slider_5 = Slider(0.21, range=0..1)
subtraction = Subtraction(A=1, B=reflectivity)
one_over_x = OneOverX(Value=u_value)
one_over_x_2 = OneOverX(Value=u_value_2)
separatebynormal = Honeybee_SeparateByNormal(geometry=brep_3, maxUpDecAngle=number_slider, maxDownDecAngle=number_slider)  # -> simplify(lookingUp), simplify(lookingDown), simplify(lookingSide); plug-in component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
division = Division(A=number_slider_2, B=number_slider_3)
division_2 = Division(A=number_slider_4, B=number_slider_5)
epopaquemat = Honeybee_EnergyPlusOpaqueMaterial(
    name="SIA380_insulation_ground",
    thickness=number_slider_3,
    conductivity=number_slider_2,
    density=Slider(35, range=0..100),
    specificHeat=Slider(1450, range=0..10000),
    solAbsp=Slider(0.8, range=0..1))  # -> EPMaterial; plug-in component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
epopaquemat_2 = Honeybee_EnergyPlusOpaqueMaterial(
    name="SIA380_insulation_exposed",
    thickness=number_slider_5,
    conductivity=number_slider_4,
    density=Slider(35, range=0..100),
    specificHeat=Slider(1450, range=0..10000),
    solAbsp=Slider(0.8, range=0..1))  # -> EPMaterial; plug-in component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
epopaquemat_3 = Honeybee_EnergyPlusOpaqueMaterial(
    name="wall_mass",
    thickness=Slider(0.2, range=0..1),
    conductivity=Slider(1.95, range=0..10),
    density=Slider(2240, range=0..10000),
    specificHeat=Slider(900, range=0..1000))  # -> EPMaterial; plug-in component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
u_value_3 = Panel(division)
u_value_4 = Panel(division_2)
epnomassmat = Honeybee_EnergyPlusNoMassOpaqueMaterial(name="SIA380exp", R_Value=one_over_x, solAbsp=subtraction)  # -> EPMaterial; plug-in component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
epnomassmat_2 = Honeybee_EnergyPlusNoMassOpaqueMaterial(name="SIA380grn", R_Value=one_over_x_2)  # -> EPMaterial; plug-in component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
lng = ListLength(List=brep_3)
series = Series(Start=0, Step=1, Count=lng)
int = Integer(graft(series))
createhbsrfs = Honeybee_createHBSrfs(geometry=separatebynormal.lookingUp, srfType=Slider(1, range=0..1), EPConstruction="SIA380-EXPOSED")  # -> readMe, simplify(HBSurface); plug-in component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
repeat = RepeatData(Data="bldg", Length=lng)  # -> graft(Data)
epconstruction = Honeybee_EnergyPlusConstruction(name="SIA380-exposed", layer_1=epopaquemat_2, layer_2=epopaquemat_3)  # -> EPConstruction; plug-in component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
createhbsrfs_2 = Honeybee_createHBSrfs(geometry=separatebynormal.lookingDown, srfType=Slider(2, range=0..10), EPBC="Ground", EPConstruction="SIA380-GROUND")  # -> readMe, simplify(HBSurface); plug-in component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
createhbsrfs_3 = Honeybee_createHBSrfs(geometry=separatebynormal.lookingSide, srfType=Slider(0, range=0..100), EPConstruction="SIA380-EXPOSED")  # -> readMe, simplify(HBSurface); plug-in component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
epconstruction_2 = Honeybee_EnergyPlusConstruction(name="SIA380-ground", layer_1=epopaquemat, layer_2=epopaquemat_3)  # -> EPConstruction; plug-in component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
epconstruction_3 = Honeybee_EnergyPlusConstruction(name="SIA380-exposed-nomass", layer_1=epnomassmat)  # -> EPConstruction; plug-in component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
epconstruction_4 = Honeybee_EnergyPlusConstruction(name="SIA380-ground-nomass", layer_1=epnomassmat_2)  # -> EPConstruction; plug-in component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
join = TextJoin(Text=[repeat, int])  # -> simplify(flatten(Result))
path_mapper = PathMapper(createhbsrfs_3.HBSurface, source="{A;B}", target="{A}")
createhbzones = Honeybee_createHBZones(
    name=simplify(graft(join)),
    HBSurfaces=[createhbsrfs.HBSurface, createhbsrfs_2.HBSurface, path_mapper],
    isConditioned=True)  # -> readMe, simplify(HBZone); plug-in component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
toggle_2 = BooleanToggle(True)
addtoeplibrary = Honeybee_AddToEnergyPlusLibrary(
    EPObject=[epconstruction_3, epconstruction_4, epconstruction_2, epconstruction],
    addToProjectLib=toggle_2,
    overwrite=toggle_2)  # -> readMe; plug-in component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
solveadjc = Honeybee_SolveAdjacencies(HBZones=flatten(createhbzones.HBZone), removeCurrentAdjc=False, findAdjc=Toggle(True))  # -> readMe, HBZonesWADJ; plug-in component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
panel_3 = Panel(addtoeplibrary)
hbzones = Data(solveadjc.HBZonesWADJ)

decomposeepmaterial = Honeybee_DecomposeEPMaterial()  # -> names, values, comments, UValue_SI, UValue_IP, RValue_SI, RValue_IP; plug-in component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
runenergysimulation = Honeybee_RunEnergySimulation()  # -> report, idfFileAddress, resultFileAddress, studyFolder; plug-in component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
number_slider_6 = Slider(10, range=0..10)
custom_mesh_settings = SettingsCustom(
    StitchSeams=True,
    SimplePlanes=False,
    Refine=True,
    MinCount=0,
    MaxCount=0,
    AspectRatio=20,
    MaxDistance=0,
    MaxAngle=20,
    MinEdge=number_slider_6,
    MaxEdge=number_slider_6)

# ----
# 1. Set Weather File
button = Button()
path = FilePath(directory)
epw_path_2 = FilePath(epw_path)
epw_to_clim = Honeybee_EpwToClim(epwFile=epw_path_2, dir=path, Run=button)  # -> out, CSobj; plug-in component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

brep_4 = Brep(brep_2)
mesh = MeshBrep(Brep=brep_4, Settings=custom_mesh_settings)

# ----
# 2. Define obstructions
horiziontal = Panel("""0
90
180
270
360""")
vertical = Panel("""10
10
10
10
10""")
context = Brep([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])
jagged = SettingsSpeed()
terrain_mesh = Mesh(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)
name_2 = Text(name)
mesh_2 = MeshBrep(Brep=context, Settings=jagged)
directory_2 = FilePath(directory)
directory_3 = FilePath(directory)
name_3 = Text(name)
false = Boolean(False)
directory_4 = FilePath(directory)
name_4 = Text(name)
citysim_srf = Honeybee_CitySimSrf(S=mesh_2, R=Slider(0.2, range=0..1), dir=directory_2, name=name_2, Write=Button())  # -> out, CSobj; plug-in component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
citysim_srf_2 = Honeybee_CitySimSrf(S=terrain_mesh, R=Slider(0.1, range=0..1), type="terrain", Dup=false, dir=directory_3, name=name_3, Write=Button())  # -> out, CSobj; plug-in component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
citysim_horizon = Honeybee_CitySimHorizon(H=horiziontal, V=vertical, dir=directory_4, name=name_4, Write=Button())  # -> out, CSobj; plug-in component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

faceb = FaceBoundaries(Mesh=mesh)  # -> simplify(Boundaries)

# ----
# 3. Define schedules
# Occupancy is mandatory for thermal simulations.
# This component is still very limited (WIP).
daily_occupation_ratios = Panel("""1
1
1
1
1
1
1
1
1
1
1
1
1
1
1
1
1
1
1
1
1
1
1
1""")
directory_5 = FilePath(directory)
name_5 = Text(name)
citysim_schedules = Honeybee_CitySimSchedules(dir=directory_5, day=daily_occupation_ratios, name=name_5, Write=Button())  # -> out, CSobj; plug-in component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

detailed_surfaces = Surface(faceb)
csobjs = Data([epw_to_clim.CSobj, citysim_horizon.CSobj, citysim_srf_2.CSobj, citysim_srf.CSobj, citysim_schedules.CSobj])

# ----
# 4. Run simulation using HB Zones
hbzones_2 = Data(hbzones)
windows_settings = Panel("""0.4
0.5
1.0
0.0""")
occupancy_settings = Panel("""5
0""")
hbzones_3 = Data(hbzones_2)
directory_6 = FilePath(directory)
solver = Text(solver_path)
name_6 = Text(name)
citysim_runsimulation = Honeybee_CitySimRunSimulation(
    HBZones=flatten(hbzones_3),
    Windows=windows_settings,
    Occupancy=occupancy_settings,
    CSobjs=csobjs,
    dir=directory_6,
    name=name_6,
    Solver=solver,
    Write=Toggle(False),
    Run=Toggle(False))  # -> out; plug-in component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

# ----
# 5. Load results
toggle_3 = BooleanToggle(False)
directory_7 = FilePath(directory)
name_7 = Text(name)
hbzones_4 = Data(hbzones_2)
citysim_loadresults = Honeybee_CitySimLoadResults(dir=directory_7, name=name_7, yearly=toggle_3, HBZones=flatten(hbzones_4), Run=Toggle(False))  # -> SW, H, C, Geometry; plug-in component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

hourly_heating_needs = Data(citysim_loadresults.H)
hourly_cooling_needs = Data(citysim_loadresults.C)
hourly_irradiances = Data(citysim_loadresults.SW)

# ----
# 7. Create a solar radiation map
crv = Curve()
hourly_values = Data()
srf = Surface(crv)
ma = MassAddition(Input=hourly_values)  # -> Result, PartialResults
division_3 = Division(A=ma.Result, B=1000)
bnd = Bounds(Numbers=flatten(division_3))
dedomain = DeconstructDomain(Domain=bnd)  # -> Start, End
gradient = Gradient(
    LowerLimit=Slider(0, range=0..100),
    UpperLimit=dedomain.End,
    Parameter=division_3,
    stops=[0: RGB(0, 0, 255), 0.501: RGB(255, 255, 0), 1: RGB(255, 0, 0)])
preview = CustomPreview(Geometry=srf, Shader=gradient)

# ----
# 5b. Run simulation using geometry only
# This workflow does not rely on Honeybee zones.
# It is intended for solar calculations on detailed meshed, for which it is faster than the workflow based on HB.
crv_2 = Curve(detailed_surfaces)
name_8 = Text(name)
name_9 = Text(name_8)
csobjs_2 = Data(csobjs)
solver_2 = Text(solver_path)
directory_8 = FilePath(directory)
name_10 = Text(name_9)
crv_3 = Curve(crv_2)

# ---- group: set solar reflectance for each surface
crv_4 = Curve(crv_2)
lng_2 = ListLength(List=flatten(crv_4))
dup = DuplicateData(Data=Slider(0.2, range=0..1), Number=lng_2, Order=True)
unflatten = UnflattenTree(Tree=dup, Guide=crv_4)
reflectance = Data(unflatten)

# ----
reflectance_2 = Data(reflectance)
citysim_solar = Honeybee_CitySimSolar(
    geometry=crv_3,
    reflectance=reflectance_2,
    CSobjs=csobjs_2,
    dir=directory_8,
    name=name_10,
    Solver=solver_2,
    Write=Toggle(False),
    Run=Toggle(False))  # -> out; plug-in component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

# ----
# 6b. Load results
# (SW only)
toggle_4 = BooleanToggle(False)
directory_9 = FilePath(directory)
name_11 = Text(name_9)
crv_5 = Curve(crv_2)
citysim_loadsolar = Honeybee_CitySimLoadSolar(dir=directory_9, name=name_11, geometry=crv_5, Run=toggle_4)  # -> results; plug-in component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

crv_6 = Curve(graft(crv_5))
ma_2 = MassAddition(Input=citysim_loadsolar)  # -> Result, PartialResults
